# Grasshopper definition chandelier.gh (Grasshopper 1.0.8)

# ---- group: Creating the spriral
number_slider = Slider(1000, range=0..1000)
curve = Curve(<curve referenced from the Rhino model>)
number_slider_2 = Slider(4, range=0..10)
divide_curve = DivideCurve(Count=number_slider, Kinks=False)  # -> Points, Tangents, Parameters
construct_domain = ConstructDomain(DomainStart=number_slider_2, DomainEnd=number_slider_2)
unit_z = UnitZ(Factor=1)
list_item = ListItem(List=divide_curve.Points, Index=Slider(40, range=0..100), Wrap=True)
range = Range(Domain=construct_domain, Steps=number_slider)
negative = Negative(Value=unit_z)
line_sdl = LineSDL(Start=divide_curve.Points, Direction=negative, Length=1)
graph_mapper = GraphMapper(range, x0=0, x1=1, y0=0, y1=1, Gx=0.2266226262, Gy=0.654815197, Ox=0, Oy=0, container_name="Square Root")
center_box = CenterBox(Base=PlaneXY(0, 0, 0), X=1, Y=Slider(1, range=0..1), Z=graph_mapper)
volume = Volume(Geometry=center_box)  # -> Volume, Centroid

# ---- group: Voronio Cells
surface = Surface(<surface referenced from the Rhino model>)
surface_2 = Surface(<surface referenced from the Rhino model>)
dimensions = Dimensions(Surface=surface)  # -> UDimension, VDimension
plane_surface = PlaneSurface(Plane=PlaneXY(0, 0, 0), XSize=dimensions.UDimension, YSize=dimensions.VDimension)
point = Point([Point(57.57278609, 0.4577939257, 0), Point(57.57278609, 0.4577939257, 3.26860644), Point(71.53064292, 0.4577939257, 3.26860644), Point(71.53064292, -3.249631195, 3.26860644), Point(74.57078109, -3.249631195, 3.26860644), Point(74.57078109, 0.265701829, 3.26860644), Point(80.17443796, 0.265701829, 3.26860644)])
curve_2 = Curve(plane_surface)
populate_geometry = PopulateGeometry(Geometry=plane_surface, Count=Slider(547, range=0..1000), Seed=Slider(59, range=0..100), Points=point)
voronoi = Voronoi(Points=populate_geometry, Boundary=curve_2, BruteForceOverride=False)
area = Area(Geometry=voronoi)  # -> Area, Centroid
scale = Scale(Geometry=voronoi, Center=area.Centroid, Factor=Slider(0.36, range=0..1))  # -> Geometry, Transform
curve_3 = Curve(flatten([curve_2, scale.Geometry]))
unit_z_2 = UnitZ(Factor=1)
boundary_surfaces = BoundarySurfaces(Edges=curve_3)
number_slider_3 = Slider(1, range=0..1)
extrude = Extrude(Base=boundary_surfaces, Direction=unit_z_2)
box = Box(extrude)
surface_morph = SurfaceMorph(
    Geometry=extrude,
    Reference=box,
    Surface=reparameterize(surface),
    UDomain=number_slider_3,
    VDomain=number_slider_3,
    WDomain=number_slider_3)

# ----
number_slider_4 = Slider(3.6, range=0..10)  # disabled

# ---- group: Pontential Spirals
graph_mapper_2 = GraphMapper(x0=0, x1=1, y0=0, y1=1, container_name="Sine", Equation_px=[0, 0.2932552695], Equation_py=[0, 0.7798798084])  # disabled
graph_mapper_3 = GraphMapper(
    x0=0,
    x1=1,
    y0=0,
    y1=1,
    A=0.9564880468,
    B=0.01087798831,
    container_name="Linear",
    Graph_x0=0.25,
    Graph_x1=0.5501289964,
    Graph_y0=0.25,
    Graph_y1=0.5370697975)  # disabled
graph_mapper_4 = GraphMapper(x0=0, x1=1, y0=0, y1=1, Ox=0.6287452579, Oy=0.2743968368, Px=0.7653357387, Py=0.2533830404, container_name="Parabola")  # disabled

# ----
unit_z_3 = UnitZ(Factor=1)  # disabled
line_sdl_2 = LineSDL(Direction=unit_z_3, Length=number_slider_4)  # disabled
bounding_box = BoundingBox(Content=flatten(line_sdl_2), Plane=PlaneXY(0, 0, 0), UnionBox=True)  # -> Box, Box_2; disabled

# ---- group: Old Version for finding center for rod
box_corners = BoxCorners()  # -> CornerA, CornerB, CornerC, CornerD, CornerE, CornerF, CornerG, CornerH
list_item_2 = ListItem(
    List=[box_corners.CornerA, box_corners.CornerB, box_corners.CornerC, box_corners.CornerD, box_corners.CornerE, box_corners.CornerF, box_corners.CornerG, box_corners.CornerH],
    Index=Slider(6, range=0..10),
    Wrap=True)
list_item_3 = ListItem(
    List=[box_corners.CornerB, box_corners.CornerA, box_corners.CornerC, box_corners.CornerD, box_corners.CornerE, box_corners.CornerF, box_corners.CornerG, box_corners.CornerH],
    Index=Slider(0, range=0..100),
    Wrap=True)
list_item_4 = ListItem(
    List=[box_corners.CornerA, box_corners.CornerB, box_corners.CornerD, box_corners.CornerE, box_corners.CornerF, box_corners.CornerG, box_corners.CornerH, box_corners.CornerC],
    Index=Slider(58, range=0..100),
    Wrap=True)
deconstruct = Deconstruct(Point=list_item_3)  # -> XComponent, YComponent, ZComponent
deconstruct_2 = Deconstruct(Point=list_item_4)  # -> XComponent, YComponent, ZComponent
merge = Merge(Data1=deconstruct.YComponent, Data2=deconstruct_2.YComponent)
merge_2 = Merge(Data1=deconstruct.XComponent, Data2=deconstruct_2.XComponent)
average = Average(Input=merge)
average_2 = Average(Input=merge_2)
construct_point = ConstructPoint(XCoordinate=average_2, YCoordinate=average, ZCoordinate=list_item_3)

# ----
scale_nu = ScaleNU(Geometry=bounding_box.Box, Plane=bounding_box.Box, ScaleX=1, ScaleY=1, ScaleZ=1)  # -> Geometry, Transform; disabled
deconstruct_domain² = DeconstructDomain²(Domain=scale_nu.Geometry)  # -> UMin, UMax, VMin, VMax; disabled
number_slider_5 = Slider(69.2, range=0..100)  # disabled

# ---- group: Creating the rod and finding center
bounding_box_2 = BoundingBox(Content=flatten(center_box), Plane=PlaneXY(0, 0, 0))  # -> Box, Box_2
deconstruct_box = DeconstructBox(Box=bounding_box_2.Box)  # -> Plane, X, Y, Z
deconstruct_plane = DeconstructPlane(Plane=deconstruct_box.Plane)  # -> Origin, XAxis, YAxis, ZAxis
division = Division(A=deconstruct_plane.ZAxis, B=Slider(4, range=0..10))
subtraction = Subtraction(A=deconstruct_plane.ZAxis, B=division)
construct_point_2 = ConstructPoint(XCoordinate=deconstruct_plane.XAxis, YCoordinate=deconstruct_plane.YAxis, ZCoordinate=subtraction)
unit_z_4 = UnitZ(Factor=1)
line_sdl_3 = LineSDL(Start=construct_point_2, Direction=unit_z_4, Length=Slider(25, range=0..100))
pipe = Pipe(Curve=line_sdl_3, Radius=Slider(1.5, range=0..10), Caps=0)

# ----
construct_domain_2 = ConstructDomain(DomainStart=deconstruct_domain².UMin, DomainEnd=deconstruct_domain².UMax)  # disabled
number_slider_6 = Slider(0.27, range=-1..1)  # disabled
rectangle = Rectangle(Plane=PlaneXY(0, 0, 0), XSize=construct_domain_2, YSize=number_slider_5, Radius=0)  # -> Rectangle, Length; disabled
offset_curve = OffsetCurve(Curve=rectangle.Rectangle, Distance=number_slider_6, Plane=rectangle.Rectangle, Corners=1)  # disabled
unit_z_5 = UnitZ(Factor=1)  # disabled
boundary_surfaces_2 = BoundarySurfaces(Edges=offset_curve)  # disabled
extrude_2 = Extrude(Base=boundary_surfaces_2, Direction=unit_z_5)  # disabled
populate_3d = Populate3D(Region=extrude_2, Count=100, Seed=1)  # disabled
voronoi_2 = Voronoi(Points=populate_3d, BruteForceOverride=False)  # disabled
merge_3 = Merge(Data1=surface_morph, Data2=pipe)
number_slider_7 = Slider(40, range=0..1000)  # disabled
curve_closest_point = CurveClosestPoint(Curve=voronoi_2)  # -> Point, Parameter, Distance; disabled
curve_4 = Curve(<curve referenced from the Rhino model>)
smaller_than = SmallerThan(FirstNumber=curve_closest_point.Distance, SecondNumber=number_slider_7)  # -> SmallerThan, OrEqualTo; disabled
curve_closest_point_2 = CurveClosestPoint(Curve=curve_4)  # -> Point, Parameter, Distance
sort_list = SortList(Keys=curve_closest_point_2.Distance)  # -> reverse(Keys), ValuesValuesA
list_item_5 = ListItem(List=sort_list.Keys, Index=0, Wrap=True)
division_2 = Division(A=list_item_5, B=Slider(6.12, range=0..10))
cull_pattern = CullPattern(List=voronoi_2, CullPattern=smaller_than.SmallerThan)  # disabled
cull_pattern_2 = CullPattern(CullPattern=smaller_than.SmallerThan)  # disabled
number_slider_8 = Slider(0.1, range=0..1)  # disabled
number_slider_9 = Slider(1, range=0..1)  # disabled
smaller_than_2 = SmallerThan(FirstNumber=curve_closest_point_2.Distance, SecondNumber=division_2)  # -> SmallerThan, OrEqualTo
construct_domain_3 = ConstructDomain(DomainStart=number_slider_8, DomainEnd=number_slider_9)  # disabled
bounds = Bounds(Numbers=curve_closest_point.Distance)  # disabled
construct_domain_4 = ConstructDomain(DomainStart=Slider(0.4, range=0..1), DomainEnd=Slider(1, range=0..1))
cull_pattern_3 = CullPattern(List=curve_closest_point_2.Distance, CullPattern=smaller_than_2.OrEqualTo)
remap_numbers = RemapNumbers(Value=curve_closest_point.Distance, Source=bounds, Target=construct_domain_3)  # -> Mapped, Clipped; disabled
bounds_2 = Bounds(Numbers=flatten(cull_pattern_3))
remap_numbers_2 = RemapNumbers(Value=cull_pattern_3, Source=bounds_2, Target=Domain(0, 1))  # -> Mapped, Clipped
scale_2 = Scale(Geometry=cull_pattern, Center=cull_pattern_2, Factor=remap_numbers.Mapped)  # -> Geometry, Transform; disabled
unit_z_6 = UnitZ(Factor=1)  # disabled
boundary_surfaces_3 = BoundarySurfaces(Edges=scale_2.Geometry)  # disabled
extrude_3 = Extrude(Base=boundary_surfaces_3, Direction=unit_z_6)  # disabled
merge_4 = Merge(Data2=extrude_3)  # disabled
