# Grasshopper definition table_2.gh (Grasshopper 1.0.8)

xz_plane = XZPlane(Origin=Point(0, 0, 0))
plane_surface = PlaneSurface(Plane=xz_plane, XSize=Slider(120, range=0..1000), YSize=Slider(55, range=0..100))
panel = Panel("""0
2""")
number_slider = Slider(100, range=0..100)
brep_edges = BrepEdges(Brep=plane_surface)  # -> Naked, Interior, NonManifold
list_item = ListItem(List=brep_edges.Naked, Index=panel, Wrap=True)
negative = Negative(Value=number_slider)
divide_curve = DivideCurve(Curve=list_item, Count="4", Kinks=False)  # -> Points, Tangents, Parameters
unit_y = UnitY(Factor=[negative, number_slider])
panel_2 = Panel("""1
3""")
list_item_2 = ListItem(List=divide_curve.Points, Index=panel_2, Wrap=True)
move = Move(Geometry=list_item_2, Motion=unit_y)  # -> Geometry, Transform
replace_items = ReplaceItems(List=divide_curve.Points, Item=move.Geometry, Indices=panel_2, Wrap=False)
cherry_picker = CherryPicker(divide_curve.Points, ListIndex=2, TreePath_path="{0;0;1}")
nurbs_curve = NurbsCurve(Vertices=replace_items, Degree=3, Periodic=False)  # -> flatten(Curve), Length, Domain
loft_options = LoftOptions(Closed=False, Adjust="true", Rebuild=0, Refit=0, Type=0)
loft = Loft(Curves=nurbs_curve.Curve, Options=loft_options)
range = Range(Domain=Domain(0, 1), Steps=Slider(100, range=0..100))
unit_z = UnitZ(Factor=Slider(10, range=0..10))
construct_point = ConstructPoint(XCoordinate=range, YCoordinate=0, ZCoordinate=0)
number_slider_2 = Slider(1.2, range=0..10)
iso_curve = IsoCurve(Surface=reparameterize(loft), UVPoint=construct_point)  # -> UIsocurve, VIsocurve
negative_2 = Negative(Value=number_slider_2)
curve = Curve(iso_curve.VIsocurve)
end_points = EndPoints(Curve=flatten(iso_curve.VIsocurve))  # -> Start, End
offset_curve = OffsetCurve(Curve=curve, Distance=[negative_2, number_slider_2], Corners=1)
list_item_3 = ListItem(List=end_points.Start, Index=0, Wrap=True)  # -> Item, Item1
shift_paths = ShiftPaths(Data=offset_curve, Offset=-1)
distance = Distance(PointA=list_item_3.Item, PointB=list_item_3.Item1)
loft_2 = Loft(Curves=shift_paths, Options={Adjust=False, Closed=False, LoftEnds=0, LoftSimp=0, LoftType=0, Rebuild=10, Refit=0.01})
unit_z_2 = UnitZ(Factor=distance)
move_2 = Move(Geometry=cherry_picker, Motion=unit_z_2)  # -> Geometry, Transform
ellipse = Ellipse(Plane=move_2.Geometry, Radius1=Slider(100, range=0..100), Radius2=Slider(20, range=0..100))  # -> Ellipse, Focus1, Focus2
extrude = Extrude(Base=ellipse.Ellipse, Direction=unit_z)
cap_holes = CapHoles(Brep=extrude)
solid_union = SolidUnion(Breps=cap_holes)
extrude_2 = Extrude(Base=loft_2, Direction=unit_z_2)
solid_union_2 = SolidUnion(Breps=[extrude_2, solid_union])
